# Grasshopper definition example.gh (Grasshopper 1.0.7)
# plug-ins: TJADSZY

prompt = Panel("")
negative_prompt = Panel("")
num = Slider(5, range=0..10)
width = Slider(300, range=200..1000)
height = Slider(300, range=200..1000)
model_name = ValueList({"architecturerealmix": "architecturerealmix_v11.safetensors", "revAnimated": "revAnimatedV1.2.2.safetensors"}, selected="architecturerealmix")
lora_model = ValueList({"must check": " ", "station": "<lora:station:1.2>", "zaha": "<lora:zaha:0.3>"}, selected=["must check", "station", "zaha"])
nick_name = Panel("songziyu")
view_name = Panel("111")
controlnet = BooleanToggle(True)
path = FilePath("C:\Users\songziyu\Desktop\11.png")

run = BooleanToggle(False)
config = Configuration(
    Input_active_or_not=run,
    Input_base_model=model_name,
    Input_prompt=prompt,
    Input_negative_prompt=negative_prompt,
    Input_lora=lora_model,
    Input_image_number=num,
    Input_image_width=width,
    Input_image_height=height,
    Input_nickname=nick_name,
    Input_controlnet_or_not=controlnet,
    Input_namedView=view_name,
    Input_file_path=path)
panel = Panel(config)
render = PosttoRender(Send=Toggle(False), BODY=config)
geturl = GetURL(Response=render)
item = ListItem(List=flatten(geturl), Index=Slider(0, range=0..10), Wrap=True)
image_resource = ImageResource(item)
panel_2 = Panel(item)
