# Grasshopper definition Temp.gh (Grasshopper 1.0.7)

crv = Curve([<curve referenced from the Rhino model> x28])
disc = Discontinuity(Curve=crv, Level=1)  # -> Points, Parameters
crv_2 = Curve([<curve referenced from the Rhino model> x18])
len = Length(Curve=crv_2)
item = ListItem(List=disc.Points, Index=0, Wrap=True)  # -> Item, Item1
division = Division(A=len, B=Slider(3, range=0..10))
Z = UnitZ(Factor=1)
int = Integer(division)
vec2pt = Vector2Pt(PointA=item.Item, PointB=item.Item1, Unitize=False)  # -> Vector, Length
xprod = CrossProduct(VectorA=vec2pt.Vector, VectorB=Z, Unitize=invert(False))  # -> Vector, Length
divide = DivideCurve(Curve=crv_2, Count=int, Kinks=False)  # -> Points, Tangents, Parameters
number_slider = Slider(0.1, range=0..1)
multiplication = Multiplication(A=xprod.Vector, B=number_slider)
cull_i = CullIndex(List=divide.Points, Indices="-1", Wrap=True)
cull_i_2 = CullIndex(List=divide.Points, Indices="0", Wrap=True)
merge = Merge(Data1=simplify(graft(cull_i)), Data2=simplify(graft(cull_i_2)))
Z_2 = UnitZ(Factor=number_slider)
subtraction = Subtraction(A=Z_2, B=multiplication)
item_2 = ListItem(List=merge, Index=0, Wrap=True)  # -> Item, Item1
move = Move(Geometry=item.Item1, Motion=subtraction)  # -> Geometry, Transform
move_2 = Move(Geometry=item.Item, Motion=multiplication)  # -> Geometry, Transform
Z_3 = UnitZ(Factor=1)
vec2pt_2 = Vector2Pt(PointA=item_2.Item, PointB=item_2.Item1, Unitize=False)  # -> Vector, Length
xprod_2 = CrossProduct(VectorA=vec2pt_2.Vector, VectorB=Z_3, Unitize=invert(False))  # -> Vector, Length
multiplication_2 = Multiplication(A=xprod_2.Vector, B=number_slider)
box = Box2Pt(PointA=move.Geometry, PointB=move_2.Geometry, Plane=PlaneXY(0, 0, 0))
pl = ConstructPlane(Origin=item_2.Item, XAxis=vec2pt_2.Vector, YAxis=xprod_2.Vector)
Z_4 = UnitZ(Factor=number_slider)
subtraction_2 = Subtraction(A=Z_4, B=multiplication_2)
move_3 = Move(Geometry=item_2.Item1, Motion=subtraction_2)  # -> Geometry, Transform
move_4 = Move(Geometry=item_2.Item, Motion=multiplication_2)  # -> Geometry, Transform
box_2 = Box2Pt(PointA=move_3.Geometry, PointB=move_4.Geometry, Plane=pl)
