# Grasshopper definition test.gh (Grasshopper 1.0.7)
# plug-ins: TJADSZY

panel = Panel("""装修区域
房间
分部分项工程
明细
单位""")
panel_2 = Panel("""站房部分
出站地道
架空换乘区
室外平台
高架层底面吊顶
铁路停车场""")
path = FilePath("D:\000SZY\99_Other\02Study\10CforGH\02GHPlugin\TJADSZY\test.xlsx")
nickname = TJADSZY(Run=Button(), FilePath=path, StartCellIndex="A1", TitleNames=panel, WorkSheetNames=panel_2)
